# Dynamo graph 04_Copy-Place_CA-Legend.dyn (Dynamo 2.16.2.5624)

# group: Copy "DSP Comp Ref" to Current Project and Place on Sheet > "DSP Comp Ref" Template Location
file_path = Filename("Templates\ACI_Project_Template.rte")

# group: Copy "DSP Comp Ref" to Current Project and Place on Sheet
code_block = CodeBlock { "DSP Comp Ref"; }
code_block_2 = CodeBlock { "FIXTURE PLAN"; }
code_block_3 = CodeBlock { [3.483, 2.695, 0.0]; }
copy_and_place_legend = Python(IN[0]=file_path, IN[1]=code_block, IN[2]=code_block_2, IN[3]=code_block_3)  # CPython3
# ---------- copy_and_place_legend.python (97 lines) ----------
import clr
clr.AddReference('RevitAPI')
clr.AddReference('RevitServices')
clr.AddReference('System')

from System import Guid
from System.Collections.Generic import List
from Autodesk.Revit.DB import *
from RevitServices.Persistence import DocumentManager
from RevitServices.Transactions import TransactionManager

# Get the current Revit document (the active project)
doc = DocumentManager.Instance.CurrentDBDocument

# Inputs from Dynamo
template_path = IN[0]  # File path to the Revit template (RVT) file
legend_name = IN[1]  # Name of the Legend View to extract
sheet_name = IN[2]   # Name of the sheet to place the legend on
placement_location = IN[3]  # XYZ coordinates for the placement of the legend (tuple/list)

copied_legend_id = None
legend_on_sheet_id = None

try:
    # Check if the legend view already exists in the current project
    existing_legend = next((view for view in FilteredElementCollector(doc).OfClass(View)
                            if view.ViewType == ViewType.Legend and view.Name == legend_name), None)

    if existing_legend:
        copied_legend = existing_legend
    else:
        # Open the Revit template document
        app = doc.Application
        template_doc = app.OpenDocumentFile(template_path)

        try:
            # Find the legend view by name in the template file
            legend_view = next((view for view in FilteredElementCollector(template_doc).OfClass(View)
                                if view.ViewType == ViewType.Legend and view.Name == legend_name), None)

            if legend_view is None:
                OUT = f"Error: Legend view named '{legend_name}' not found in the template."
            else:
                # Start a transaction to copy the legend into the current document
                TransactionManager.Instance.EnsureInTransaction(doc)

                # Copy the legend to the current project
                element_ids = List[ElementId]([legend_view.Id])
                copied_ids = ElementTransformUtils.CopyElements(template_doc, element_ids, doc, Transform.Identity, CopyPasteOptions())

                TransactionManager.Instance.TransactionTaskDone()

                # Get the copied legend
                copied_legend_id = copied_ids[0]
                copied_legend = doc.GetElement(copied_legend_id)
        finally:
            # Ensure the template document is closed properly
            if template_doc.IsValidObject:
                template_doc.Close(False)

    # Locate the sheet where the legend should be placed
    sheet = next((s for s in FilteredElementCollector(doc).OfClass(ViewSheet) if s.Name == sheet_name), None)

    if sheet is None:
        OUT = f"Error: Sheet named '{sheet_name}' not found in the current project."
    else:
        # Start a transaction to either place or move the legend on the sheet
        TransactionManager.Instance.EnsureInTransaction(doc)

        # Convert placement_location to XYZ
        x, y, z = placement_location
        position = XYZ(x, y, z)

        try:
            # Place the legend view on the sheet at the specified location
            viewport = Viewport.Create(doc, sheet.Id, copied_legend.Id, position)

            if viewport is None:
                OUT = f"Error: Could not place the legend '{legend_name}' on sheet '{sheet_name}'."
            else:
                legend_on_sheet_id = viewport.Id
                OUT = [
                    f"Legend '{legend_name}' successfully placed on sheet '{sheet_name}' at position ({x}, {y}, {z}).",
                    copied_legend_id.IntegerValue,
                    legend_on_sheet_id.IntegerValue
                ]
        except Exception as e:
            TransactionManager.Instance.ForceCloseTransaction()
            OUT = f"Error during placement: {e}"

        TransactionManager.Instance.TransactionTaskDone()

except Exception as e:
    OUT = f"Error: {e}"

# Output only the relevant result
OUT = OUT
# ----------------------------------------

watch = Watch(copy_and_place_legend)
code_block_4 = CodeBlock { 2; }
getItemAtIndex = List.GetItemAtIndex(list=copy_and_place_legend, index=code_block_4)
set_legend_properties = Python(IN[0]=getItemAtIndex)  # CPython3
# ---------- set_legend_properties.python (55 lines) ----------
import clr
clr.AddReference('RevitAPI')
clr.AddReference('RevitServices')

from Autodesk.Revit.DB import *
from RevitServices.Persistence import DocumentManager
from RevitServices.Transactions import TransactionManager

# Get the current Revit document
doc = DocumentManager.Instance.CurrentDBDocument

# Inputs from Dynamo
legend_on_sheet_id = IN[0]  # Element ID of the legend on the sheet

try:
    # Convert input to ElementId
    legend_on_sheet_element_id = ElementId(legend_on_sheet_id)
    legend_on_sheet = doc.GetElement(legend_on_sheet_element_id)

    # Verify if the element is found
    if legend_on_sheet is None:
        OUT = f"Error: No element found with ID {legend_on_sheet_id}."
    elif not isinstance(legend_on_sheet, Viewport):
        OUT = f"Error: Element with ID {legend_on_sheet_id} is not a Viewport."
    else:
        # Start a transaction to modify the Viewport type
        TransactionManager.Instance.EnsureInTransaction(doc)

        try:
            # Gather all viewport types available in the document
            viewport_types = FilteredElementCollector(doc).OfClass(ElementType).OfCategory(BuiltInCategory.OST_Viewports)
            
            # Output all available viewport types for debugging
            available_types = {vt.Id.IntegerValue: vt.Name for vt in viewport_types}
            
            # Find a type named "No Label"
            no_label_type = next((vt for vt in viewport_types if "No Label" in vt.Name), None)

            if no_label_type is None:
                OUT = f"Error: No viewport type named 'No Label' found. Available types: {available_types}"
            else:
                # Set the Viewport to the found type without labels
                legend_on_sheet.ChangeTypeId(no_label_type.Id)
                OUT = f"Viewport property for legend with ID {legend_on_sheet_id} set to type 'No Label'."

        except Exception as e:
            OUT = f"Error: {e}"
        finally:
            TransactionManager.Instance.TransactionTaskDone()

except Exception as e:
    OUT = f"Error: {e}"

# Output the result
OUT = OUT
# ----------------------------------------
watch_2 = Watch(set_legend_properties)
