# Dynamo graph 05_Write-CA-Legend.dyn (Dynamo 2.16.4.10216)

# group: Extract Revit Legend
code_block = CodeBlock { "DSP Comp Ref (Portrait)"; }
code_block_2 = CodeBlock { "DSP Comp Ref (Landscape)"; }
list_create = List.Create(item0=code_block, item1=code_block_2)
get_legends = Python(IN[0]=list_create)  # CPython3
# ---------- get_legends.python (45 lines) ----------
import clr
clr.AddReference("RevitAPI")
clr.AddReference("RevitServices")
from Autodesk.Revit.DB import *
from RevitServices.Persistence import DocumentManager

# Inputs
doc = DocumentManager.Instance.CurrentDBDocument

# Check if input is received
if len(IN) < 1 or not IN[0]:
    OUT = "Error: Please provide a list of legend names."
    raise SystemExit

# List of legend names to find
legend_names = IN[0]

# Ensure the input is a list of strings
if not isinstance(legend_names, list) or not all(isinstance(name, str) for name in legend_names):
    OUT = "Error: Input must be a list of strings representing legend names."
    raise SystemExit

# Get all views in the document
collector = FilteredElementCollector(doc).OfClass(View)

# Filter Legends
matching_legends = []
non_matching_legends = []
for view in collector:
    if view.ViewType == ViewType.Legend:
        if view.Name.strip() in [name.strip() for name in legend_names]:
            # Append name and Element ID for matching legends
            matching_legends.append([view.Name, view.Id.IntegerValue])
        else:
            # Append name and Element ID for non-matching legends
            non_matching_legends.append([view.Name, view.Id.IntegerValue])

# Prepare Output
output_list = [
    ["Matching Legends", matching_legends],
    ["Non-Matching Legends", non_matching_legends]
]

# Output the results
OUT = output_list
# ----------------------------------------
code_block_3 = CodeBlock { 1; }
getItemAtIndex = List.GetItemAtIndex(list=get_legends@L2, index=code_block_3)
code_block_4 = CodeBlock { 0; }
getItemAtIndex_2 = List.GetItemAtIndex(list=getItemAtIndex@L2, index=code_block_4)

# group: Extract Textnotes
extract_textnotes = Python(IN[0]=getItemAtIndex_2)  # CPython3
# ---------- extract_textnotes.python (51 lines) ----------
import clr
clr.AddReference('RevitServices')
from RevitServices.Persistence import DocumentManager
clr.AddReference("RevitAPI")
from Autodesk.Revit.DB import *

# Input Legend ID
legend_id = IN[0][0]

# Access the current Revit document
doc = DocumentManager.Instance.CurrentDBDocument

# Placeholder for output
text_notes = []

try:
    # Validate that the input is a valid integer before converting to ElementId
    if isinstance(legend_id, int):
        # Try to convert legend_id to an ElementId
        legend_element_id = ElementId(legend_id)
        
        # Get the Legend View from the document
        legend_view = doc.GetElement(legend_element_id)

        # Check if the view is a Legend type
        if isinstance(legend_view, View) and legend_view.ViewType == ViewType.Legend:
            # Collect all text notes within the legend view
            collector = FilteredElementCollector(doc, legend_view.Id)
            text_elements = collector.OfCategory(BuiltInCategory.OST_TextNotes).WhereElementIsNotElementType().ToElements()
            
            # Extract text, Legend Index, position, and index from each TextNote element
            for index, text_element in enumerate(text_elements, start=1):
                if isinstance(text_element, TextNote):
                    text = text_element.Text.strip()
                    location = text_element.Coord  # Get XYZ position
                    text_notes.append([
                        text,
                        [
                            "Legend Index", index,
                            ["Position", location.X, location.Y, location.Z]
                        ]
                    ])
        else:
            text_notes.append(["Error: The provided ID does not correspond to a Legend View."])
    else:
        text_notes.append(["Error: Invalid input type. Please provide a valid integer ID."])
except Exception as e:
    text_notes.append([f"Error: An error occurred: {str(e)}"])

# Output the collected text notes
OUT = text_notes
# ----------------------------------------

# group: Detect Relationship of Textnotes
arrange_into_columns_and_rows = Python(IN[0]=extract_textnotes)  # CPython3
# ---------- arrange_into_columns_and_rows.python (55 lines) ----------
import clr
clr.AddReference('RevitServices')
from RevitServices.Persistence import DocumentManager
from RevitServices.Transactions import TransactionManager

clr.AddReference("RevitAPI")
from Autodesk.Revit.DB import *

# Inputs
text_notes = IN[0]  # Nested list containing TextNotes data

# Function to determine column and row boundaries based on the positions of TextNotes
def infer_grid_dimensions(text_notes):
    x_values = []
    y_values = []
    
    # Extract X and Y coordinates from the nested list
    for note in text_notes:
        position_data = note[1][2]
        _, x, y, _ = position_data
        x_values.append(x)
        y_values.append(y)
    
    # Sort and calculate the average difference between sorted unique values as the inferred width/height
    unique_x_values = sorted(set(x_values))
    unique_y_values = sorted(set(y_values))
    
    column_width = (max(unique_x_values) - min(unique_x_values)) / (len(unique_x_values) - 1) if len(unique_x_values) > 1 else 1
    row_height = (max(unique_y_values) - min(unique_y_values)) / (len(unique_y_values) - 1) if len(unique_y_values) > 1 else 1
    
    return column_width, row_height

# Infer column width and row height
column_width, row_height = infer_grid_dimensions(text_notes)

# Function to determine column and row indices based on X, Y values
def calculate_grid_indices(x, y, column_width, row_height):
    column = int(x // column_width) + 1  # Convert to 1-based index
    row = int(y // row_height) + 1       # Convert to 1-based index
    return column, row

# Loop through each TextNote and add Column and Row information to the nested list
for note in text_notes:
    position_data = note[1][2]
    _, x, y, _ = position_data
    
    # Calculate column and row indices
    column, row = calculate_grid_indices(x, y, column_width, row_height)
    
    # Move Column and Row data to the same level as the note title
    note.insert(1, ("Column", column))
    note.insert(2, ("Row", row))

# Output (for verification in Dynamo)
OUT = text_notes
# ----------------------------------------

# group: PRODUCE
code_block_5 = CodeBlock { "MULTI-DECK PRODUCE"; }

# group: BEVERAGE
code_block_6 = CodeBlock { "MULTI-DECK SINGLE SERVE BEV"; }

# group: SERVICE DELI
code_block_7 = CodeBlock { "SERVICE DELI COLD CASE"; }
code_block_8 = CodeBlock { "SERVICE DELI HOT CASE"; }
code_block_9 = CodeBlock { "SUSHI"; }
code_block_10 = CodeBlock { "SERVICE SANDWICH"; }
code_block_11 = CodeBlock { "LOW PROFILE DELI CASE"; }
code_block_12 = CodeBlock { "MULTI-DECK DELI CASE"; }

# group: DAIRY & MEAT / DELI
code_block_13 = CodeBlock { "DAIRY COOLER DOORS (DOOR QTY x 2.5)"; }
code_block_14 = CodeBlock { "MULTI-DECK DAIRY"; }
code_block_15 = CodeBlock { "MULTI-DECK MEAT/DELI"; }
code_block_16 = CodeBlock { "TOTAL MULTI-DECK DAIRY & MEAT/DELI"; }

# group: SEAFOOD & MEAT
code_block_17 = CodeBlock { "SERVICE SEAFOOD"; }
code_block_18 = CodeBlock { "SERVICE MEAT"; }
code_block_19 = CodeBlock { "MULTI-DECK MEAT"; }

# group: TAB
code_block_20 = CodeBlock { "MULTI-DECK BEER / WINE"; }
code_block_21 = CodeBlock { "MULTI-DECK PREMIUM WINE"; }
wine_liquor_lf = CodeBlock { "WINE / LIQUOR SHELVING A"; }
wine_liquor_slf = CodeBlock { "WINE / LIQUOR SHELVING B"; }

# group: FROZEN FOOD
code_block_22 = CodeBlock { "MULTI-DECK FROZEN FOOD"; }
code_block_23 = CodeBlock { "MULTI-DECK FROZEN PROMO"; }
code_block_24 = CodeBlock { "MULTI-DECK FROZEN SEAFOOD & MEAT"; }
code_block_25 = CodeBlock { "TOTAL FROZEN FOOD (NUMBER OF DOORS)"; }

# group: SHELVING
code_block_26 = CodeBlock { "CENTER STORE SHELVING"; }
wine_liquor_lf_2 = CodeBlock { "WINE / LIQUOR SHELVING C"; }
code_block_27 = CodeBlock { "TOTAL SHELVING"; }

list_create_2 = List.Create(item0=code_block_5, item1=code_block_6, item2=code_block_7, item3=code_block_8, item4=code_block_9, item5=code_block_10, item6=code_block_11, item7=code_block_12, item8=code_block_13, item9=code_block_14, item10=code_block_15, item11=code_block_16, item12=code_block_17, item13=code_block_18, item14=code_block_19, item15=code_block_20, item16=code_block_21, item17=wine_liquor_lf, item18=wine_liquor_slf, item19=code_block_22, item20=code_block_23, item21=code_block_24, item22=code_block_25, item23=code_block_26, item24=wine_liquor_lf_2, item25=code_block_27)

# group: Search for Sub-Header and Return Data
code_block_28 = CodeBlock { 4; }
return_sub_headers = Python(IN[0]=arrange_into_columns_and_rows, IN[1]=list_create_2, IN[2]=code_block_28)  # CPython3
# ---------- return_sub_headers.python (114 lines) ----------
import clr
clr.AddReference('RevitServices')
from RevitServices.Persistence import DocumentManager
from RevitServices.Transactions import TransactionManager

import re

# Function to flatten nested list into a single-level list
def flatten_list(nested_list):
    flat_list = []
    for item in nested_list:
        if isinstance(item, list):
            flat_list.extend(flatten_list(item))
        else:
            flat_list.append(item)
    return flat_list

# Function to remove all non-alphanumeric characters, spaces, and line breaks from a string
def normalize_string(s):
    return re.sub(r'[^a-zA-Z0-9]', '', s).lower()

# Function to search for labels and return the desired columns in the original format
def find_labels_and_columns(data, labels, num_following_columns):
    results = []
    found_labels = set()
    normalized_labels = [normalize_string(label) for label in labels]
    
    # Iterate through each element in the data
    for i, element in enumerate(data):
        if isinstance(element, list) and len(element) > 0 and isinstance(element[0], str):
            label = element[0]
            normalized_label = normalize_string(label)
            if normalized_label in normalized_labels:
                # Mark the label as found
                found_labels.add(normalized_label)
                
                # Extract the row and column of the matched label
                label_row = None
                label_column = None
                for sub_element in element:
                    if isinstance(sub_element, list) and len(sub_element) > 1:
                        if sub_element[0] == 'Row':
                            label_row = sub_element[1]
                        elif sub_element[0] == 'Column':
                            label_column = sub_element[1]
                
                if label_row is None or label_column is None:
                    continue
                
                # Collect the elements in the same row, based on column values to the right of the matched label
                collected_section = [element]  # Start with the matched element itself
                columns_collected = 0  # Start collecting columns after the Sub-Header
                
                # Sort the data based on the column value to ensure proper ordering
                sorted_data = sorted([elem for elem in data if isinstance(elem, list) and len(elem) > 0], 
                                    key=lambda x: next((sub[1] for sub in x if isinstance(sub, list) and sub[0] == 'Column'), float('inf')))
                
                # Iterate over sorted data to collect elements that match the same row and are sequential to the right in terms of columns
                for other_element in sorted_data:
                    if other_element == element:
                        continue  # Skip the matched label itself
                    if isinstance(other_element, list) and len(other_element) > 0 and isinstance(other_element[0], str):
                        other_row = None
                        other_column = None
                        for sub in other_element:
                            if isinstance(sub, list) and len(sub) > 1:
                                if sub[0] == 'Row':
                                    other_row = sub[1]
                                elif sub[0] == 'Column':
                                    other_column = sub[1]
                        
                        # If rows match and the other column is strictly to the right of the matched label's column, collect the element
                        if other_row == label_row and other_column is not None and other_column > label_column and columns_collected < num_following_columns:
                            collected_section.append(other_element)
                            columns_collected += 1
                
                # Move Sub-Header to a higher level in the nesting
                sub_header = ["Sub-Header", collected_section[0][0]]
                
                # Add the remaining collected elements without extra nesting and retain their values
                labeled_section = [sub_header]
                for j, label_name in enumerate(["Type", "Existing", "Proposed", "Variation"], start=1):
                    if j < len(collected_section):
                        # Retain the value of the label (second element in the list)
                        value = collected_section[j][1] if len(collected_section[j]) > 1 else None
                        labeled_section.append([label_name, collected_section[j][0] if len(collected_section[j]) > 0 else None, value] + collected_section[j][2:])
                    else:
                        # If there's no corresponding collected element, add an empty value placeholder
                        labeled_section.append([label_name, None])
                
                results.append(labeled_section)

    # Check if all labels were found, if not append the error to OUT
    if len(found_labels) != len(normalized_labels):
        missing_labels = [label for label in labels if normalize_string(label) not in found_labels]
        if missing_labels:
            return f"Error: The following labels were not found in the data: {missing_labels}"

    return results

# Input data: The structured dataset and list of labels of interest from Dynamo UI input
data = IN[0]  # Expecting input from Dynamo to be a structured list

# Dynamically input labels of interest from user (Dynamo UI input)
labels_of_interest = IN[1]  # Expecting input from Dynamo to be a list of labels

# Input for number of following columns to collect (Dynamo UI input)
num_following_columns = IN[2]  # Expecting input from Dynamo to be an integer specifying the number of following columns

# Find labels and their respective columns
matched_results = find_labels_and_columns(data, labels_of_interest, num_following_columns)

# Output the results in the same format as the input
OUT = matched_results
# ----------------------------------------

# group: Restructure List
resturcture_list_sub_headers = Python(IN[0]=return_sub_headers)  # CPython3
# ---------- resturcture_list_sub_headers.python (51 lines) ----------
import clr
clr.AddReference('ProtoGeometry')
from Autodesk.DesignScript.Geometry import *

# Importing Revit Nodes
clr.AddReference('RevitServices')
import RevitServices
from RevitServices.Persistence import DocumentManager
from RevitServices.Transactions import TransactionManager

# Import Revit API
clr.AddReference('RevitAPI')
import Autodesk
from Autodesk.Revit.DB import *

# Main function for reformatting list structure
def reformat_list_structure(input_list):
    reformatted_list = []
    
    for sublist in input_list:
        # Ensure sublist is a list
        if isinstance(sublist, list):
            sub_header = None
            rest_items = []
            
            # Loop through each item in the sublist
            for item in sublist:
                # Extract the Sub-Header if present
                if isinstance(item, list) and len(item) > 1 and item[0] == "Sub-Header":
                    sub_header = item  # Retain the entire Sub-Header list, including the label
                else:
                    # Flatten one level of the rest items if they are lists themselves
                    if isinstance(item, list) and len(item) > 0:
                        rest_items.append(item)
                    else:
                        rest_items.append(item)
            
            # If a Sub-Header was found, add it to the reformatted list as the top-level key with the rest of the items directly under it
            if sub_header:
                reformatted_list.append([sub_header[0], sub_header[1]] + rest_items)
    
    return reformatted_list

# Inputs from Dynamo
input_list = IN[0]

# Perform the reformatting
output_list = reformat_list_structure(input_list)

# Assign the output to Dynamo
OUT = output_list
# ----------------------------------------

# group: Current Project
current = Document.Current()
filePath = Document.FilePath(document=current)

# group: Return the Folder of the Current Project
code_block_29 = CodeBlock { "\\"; }
code_block_30 = CodeBlock { "\\"; }
split = String.Split(string=filePath, separator0=code_block_30)
code_block_31 = CodeBlock { -1; }
dropItems = List.DropItems(list=split, amount=code_block_31)
join = String.Join(separator=code_block_29, string0=dropItems)

# group: Master Check Template Location
file_path = Filename("Templates\02_Master-Check.xlsx")
file_from_path = FileObject(path=file_path)
string_from_object = FromObject(object=file_from_path)

# group: Return the File Name of the Master Check Template
code_block_32 = CodeBlock { "\\"; }
code_block_33 = CodeBlock { "\\"; }
split_2 = String.Split(string=string_from_object, separator0=code_block_33)
lastItem = List.LastItem(list=split_2)
join_2 = String.Join(separator=code_block_32, string0=lastItem)

# group: Combine Into the Current Project Path and Template Name for Master Check
code_block_34 = CodeBlock { "\\"; }
combinePath = FileSystem.CombinePath(string0=join, string1=join_2)
join_3 = String.Join(separator=code_block_34, string0=combinePath)

# group: Read from Takeoff Excel
file_from_path_2 = FileObject(path=join_3)
string = StringInput("CA")
boolean = BoolSelector(true)
boolean_2 = BoolSelector(true)
importExcel = Data.ImportExcel(file=file_from_path_2, sheetName=string, readAsStrings=boolean, showExcel=boolean_2)
code_block_35 = CodeBlock { 1; }
flatten = List.Flatten(list=importExcel, amount=code_block_35)

# group: Process Sub-Headers
process_sub_headers_from_excel = Python(IN[0]=flatten, IN[1]=list_create_2)  # CPython3
# ---------- process_sub_headers_from_excel.python (56 lines) ----------
# Input from Excel Import Node (flattened data)
excel_data = IN[0]

# Input list of Sub-Headers to be matched
sub_headers_to_match = IN[1]

# Initialize an empty list to hold the data in the desired list of lists format
data_rows = []

try:
    # Check if sub_headers_to_match is a list
    if not isinstance(sub_headers_to_match, list):
        raise ValueError("Sub-Headers to match must be provided as a list.")

    # Create a list to track unmatched sub-headers
    unmatched_sub_headers = sub_headers_to_match.copy()

    # Iterate through each row in the Excel data
    for row in excel_data:
        # Check if the row is a valid list and has at least 6 fields
        if isinstance(row, list) and len(row) >= 6:
            # Extract and format the required data, providing sensible default values where necessary
            sub_header = row[1] if row[1] else "N/A"
            item_type = row[2] if row[2] else "N/A"
            existing = row[3] if row[3] is not None and row[3] != "" else 0
            proposed = row[4] if row[4] is not None and row[4] != "" else 0
            variation = row[5] if row[5] is not None and row[5] != "" else 0

            # Only include rows with meaningful sub-header data that matches the provided list
            if sub_header in sub_headers_to_match:
                # Create a list for the row, formatted to match the desired output structure with individual labeled lists
                row_list = [
                    "Sub-Header", sub_header,
                    ["Type", item_type],
                    ["Existing", existing],
                    ["Proposed", proposed],
                    ["Variation", variation]
                ]

                # Append the row list to the data rows
                data_rows.append(row_list)

                # Remove one occurrence of the matched sub-header from unmatched list if present
                if sub_header in unmatched_sub_headers:
                    unmatched_sub_headers.remove(sub_header)

    # Check for unmatched sub-headers and raise an error if any remain
    if unmatched_sub_headers:
        raise ValueError("The following Sub-Headers were not found in the input data: {}".format(", ".join(unmatched_sub_headers)))

    # Set output to the list of lists
    OUT = data_rows if data_rows else "No valid rows found in input data. Check the structure of the input or revise the extraction logic."

except Exception as e:
    # Output any errors that occur
    OUT = "Error occurred: {}".format(str(e))
# ----------------------------------------

# group: Combine Lists
update_revit_from_excel = Python(IN[0]=resturcture_list_sub_headers, IN[1]=process_sub_headers_from_excel)  # CPython3
# ---------- update_revit_from_excel.python (53 lines) ----------
import clr
clr.AddReference('RevitServices')
from RevitServices.Persistence import DocumentManager
from RevitServices.Transactions import TransactionManager

clr.AddReference('RevitAPI')
from Autodesk.Revit.DB import *

clr.AddReference('RevitNodes')
import Revit
clr.ImportExtensions(Revit.Elements)
clr.ImportExtensions(Revit.GeometryConversion)

# Inputs from Dynamo
revit_data_list = IN[0]  # Expected to be a list of Revit-related data structures
excel_data_list = IN[1]  # Expected to be a list of Excel-related data structures

# Output container
OUT = []

# Access the active Revit document
doc = DocumentManager.Instance.CurrentDBDocument

def find_subheader_index(data_list, subheader):
    """Find the index of the subheader in the data list."""
    for index, item in enumerate(data_list):
        if isinstance(item, list) and len(item) > 1 and item[1] == subheader:
            return index
    return None

def update_revit_data(revit_data, excel_data):
    """Update the Revit data list with values from the Excel data list based on the Sub-Header key."""
    for excel_item in excel_data:
        if isinstance(excel_item, list) and len(excel_item) > 1:
            subheader = excel_item[1]
            revit_index = find_subheader_index(revit_data, subheader)
            if revit_index is not None:
                revit_item = revit_data[revit_index]
                for i in range(2, len(excel_item)):
                    if isinstance(excel_item[i], list) and len(excel_item[i]) > 1:
                        key = excel_item[i][0]
                        value = excel_item[i][1]
                        for j in range(2, len(revit_item)):
                            if isinstance(revit_item[j], list) and len(revit_item[j]) > 1 and revit_item[j][0] == key:
                                revit_item[j][1] = value

# Update the Revit data list with Excel data
try:
    update_revit_data(revit_data_list, excel_data_list)
    OUT.append("Update completed for input: revit_data_list with excel_data_list")
    OUT.append(revit_data_list)
except Exception as e:
    OUT.append(f"Error during update of revit_data_list with excel_data_list: {str(e)}")
# ----------------------------------------

watch = Watch(update_revit_from_excel)

# group: Write to Schedule
write_to_schedule = Python(IN[0]=update_revit_from_excel, IN[1]=getItemAtIndex_2)  # CPython3
# ---------- write_to_schedule.python (114 lines) ----------
import clr
clr.AddReference('RevitServices')
from RevitServices.Persistence import DocumentManager
from RevitServices.Transactions import TransactionManager

clr.AddReference('RevitAPI')
from Autodesk.Revit.DB import *

clr.AddReference('RevitNodes')
import Revit
clr.ImportExtensions(Revit.Elements)
clr.ImportExtensions(Revit.GeometryConversion)

doc = DocumentManager.Instance.CurrentDBDocument
OUT = []

def update_textnotes_from_data(revit_data_list, target_legend_id):
    # Find the first TextNoteType in the document
    text_note_type = FilteredElementCollector(doc)\
        .OfClass(TextNoteType)\
        .FirstElement()
    if not text_note_type:
        OUT.append("Error: No TextNoteType found in the document.")
        return

    OUT.append("Combined Revit and Excel Data Received.")

    # Verify the target LegendID exists in the document
    target_legend_element = doc.GetElement(target_legend_id)
    if not target_legend_element:
        OUT.append(f"Error: Target LegendID {target_legend_id.IntegerValue} not found in the document.")
        return
    else:
        OUT.append(f"Target LegendID {target_legend_id.IntegerValue} successfully located in the document.")

    # Start a transaction to update TextNotes
    TransactionManager.Instance.EnsureInTransaction(doc)
    try:
        for sublist in revit_data_list:
            if isinstance(sublist, list) and len(sublist) > 0:
                # Process each Sub-Header
                sub_header_entries = [entry for entry in sublist if isinstance(entry, list) and entry[0] == "Sub-Header"]
                for sub_header_entry in sub_header_entries:
                    sub_header_name = sub_header_entry[1]
                    OUT.append(f"Processing Sub-Header: {sub_header_name}")

                    # Track if any fields were processed for the Sub-Header
                    fields_processed = []

                    # Iterate through all sub-items under the current Sub-Header
                    for item in sublist:
                        if isinstance(item, list) and len(item) > 0 and item[0] in ["Existing", "Proposed", "Variation"]:
                            field_name = item[0]
                            field_value = item[1]

                            # Locate Legend Index and Position
                            legend_index_entry = next((entry for entry in item if isinstance(entry, list) and entry[0] == "Legend Index"), None)
                            if legend_index_entry and len(legend_index_entry) > 1:
                                legend_index_value = legend_index_entry[1]
                                position_entry = next((entry for entry in legend_index_entry if isinstance(entry, list) and entry[0] == "Position"), None)

                                # Attempt to locate the TextNote using Legend Index
                                try:
                                    legend_element = doc.GetElement(ElementId(legend_index_value))
                                    if legend_element and isinstance(legend_element, TextNote):
                                        legend_element.Text = str(field_value)
                                        OUT.append(f"Updated TextNote for {field_name} (Legend Index: {legend_index_value}) with value: {field_value}")
                                        fields_processed.append(field_name)
                                    else:
                                        OUT.append(f"Legend Index {legend_index_value} does not correspond to a TextNote.")
                                except Exception as e:
                                    OUT.append(f"Error accessing Legend Index {legend_index_value}: {str(e)}")

                                # Fallback to Position if Legend Index fails
                                if not legend_element and position_entry:
                                    try:
                                        position_data = XYZ(
                                            float(position_entry[1]),
                                            float(position_entry[2]),
                                            float(position_entry[3])
                                        )
                                        new_note = TextNote.Create(
                                            doc,
                                            target_legend_id,
                                            position_data,
                                            str(field_value),
                                            text_note_type.Id
                                        )
                                        OUT.append(f"Created TextNote at {position_data} for {field_name} with value: {field_value}")
                                        fields_processed.append(field_name)
                                    except Exception as e:
                                        OUT.append(f"Error creating TextNote at Position {position_entry}: {str(e)}")
                            else:
                                OUT.append(f"No Legend Index found for {field_name} under Sub-Header {sub_header_name}.")

                    # Debug the processed fields for the Sub-Header
                    if fields_processed:
                        OUT.append(f"Processed fields for Sub-Header {sub_header_name}: {', '.join(fields_processed)}")
                    else:
                        OUT.append(f"No fields were processed for Sub-Header {sub_header_name}.")
    except Exception as ex:
        OUT.append(f"Error updating text notes: {str(ex)}")
    finally:
        TransactionManager.Instance.TransactionTaskDone()

# Example input structure from Dynamo
# IN[0] = Nested list with data for TextNotes
# IN[1] = Target LegendID
try:
    input_revit_data = IN[0]
    target_legend_id = ElementId(int(IN[1][0]))  # Correctly extract LegendID from list
    update_textnotes_from_data(input_revit_data, target_legend_id)
except Exception as e:
    OUT.append(f"Error initializing script: {str(e)}")
# ----------------------------------------

watch_2 = Watch(write_to_schedule)
watch_3 = Watch(getItemAtIndex_2)
